# Grasshopper definition 20190709_opencv2gh.gh (Grasshopper 1.0.7)
# plug-ins: gHowl

local_ip = Panel("your local ip")
port = Panel("5000")
udp = UDPReceiver(Address=local_ip, Port=port, Pattern=0)  # -> Info, Data
split = TextSplit(Text=udp.Data, Separators=",")
panel = Panel(udp.Info)
panel_2 = Panel(udp.Data)
item = ListItem(List=split, Index=0, Wrap=True)  # -> Item, Item1, Item2, Item3, Item4
number_slider = Slider(20, range=0..100)
rectangle = Rectangle(Plane=PlaneXY(0, 0, 0), XSize=item.Item3, YSize=item.Item4, Radius=0)  # -> Rectangle, Length
division = Division(A=item.Item3, B=number_slider)
division_2 = Division(A=item.Item4, B=number_slider)
srf = Surface(rectangle.Rectangle)
panel_3 = Panel(split)
pt = ConstructPoint(XCoordinate=item.Item, YCoordinate=item.Item1, ZCoordinate=0)
divide = DivideDomain²(Domain=srf, UCount=division, VCount=division_2)
subsrf = Isotrim(Surface=srf, Domain=divide)
pt_2 = Point(pt)
area = Area(Geometry=subsrf)  # -> Area, Centroid
expression = Expression(x=item.Item4, y=Slider(1, range=0..1), Expression="x*y")
dist = Distance(PointA=pt_2, PointB=area.Centroid)
dom = ConstructDomain(DomainStart=0, DomainEnd=expression)
dom_2 = ConstructDomain(DomainStart=Slider(10, range=0..10), DomainEnd=Slider(90, range=0..1000))
remap = RemapNumbers(Value=item.Item2, Source=dom, Target=dom_2)  # -> Mapped, Clipped
bnd = Bounds(Numbers=dist)
remap_2 = RemapNumbers(Value=dist, Source=bnd, Target="1 to 0")  # -> Mapped, Clipped
graph = GraphMapper(remap_2.Mapped, x0=0, x1=1, y0=0, y1=1, container_name="Bezier", cpx=[0, 0.674728632, 0.7355072498, 1], cpy=[0, 0, 1, 1])
multiplication = Multiplication(A=graph, B=remap.Mapped)
bnd_2 = Bounds(Numbers=multiplication)
Y = UnitY(Factor=1)
dedomain = DeconstructDomain(Domain=bnd_2)  # -> Start, End
rot3d = Rotate3D(Geometry=subsrf, Angle=degrees(multiplication), Center=area.Centroid, Axis=Y)  # -> Geometry, Transform
gradient = Gradient(
    LowerLimit=dedomain.Start,
    UpperLimit=dedomain.End,
    Parameter=multiplication,
    stops=[0: RGB(255, 128, 0), 1: RGB(224, 224, 224)])
srf_2 = Surface(rot3d.Geometry)
preview = CustomPreview(Geometry=srf_2, Material=gradient)
